# Grasshopper definition 01_basic_planning.ghx (Grasshopper 1.0.8)
# plug-ins: Pufferfish, Virtual Robot, LCRL.Grasshopper, Motus

Z = UnitZ(Factor=Slider(0.54, range=-2.5..2.5))
Y = UnitY(Factor=Slider(-1.24, range=-2.5..2.5))
X = UnitX(Factor=Slider(-0.43, range=-2.5..2.5))
Y_2 = UnitY(Factor=Slider(0.4, range=0..10))
X_2 = UnitX(Factor=Slider(0.3, range=0..10))
addition = Addition(A=X, B=Y, C=Z)
xy = XYPlane(Origin=Point(0, 0, 0))
flippln = FlipPlane(Plane=xy, FlipX=False, FlipY=False, FlipZ=True)  # -> Flipped, R
addition_2 = Addition(A=X_2, B=Y_2)
model = ValueList({"One": 1, "Two": 2, "Three": 2² - 1, "Four": Sqrt(16), "KR 10 R1100", "KR 120 R2700", "KR 16 R2010", "KR 22 R1610", "KR 6 R900", "KR 60 R2100", "LBR iiwa 14 R820", "LBR iiwa 7 R800", "UR10e", "UR16e", "UR20", "UR30", "UR3e", "UR5e"}, selected="UR10e")
move = Move(Geometry=flippln.Flipped, Motion=addition_2)  # -> Geometry, Transform
move_2 = Move(Geometry=move.Geometry, Motion=addition)  # -> Geometry, Transform
ur10 = PredefinedUniversalRobotUR10(BaseFrame=PlaneXY(0, 0, 0))
robot = MotusRobot(Model=model)

# ---- group: Start State
number_slider = Slider(0.001, range=0..0.001)

# ----
scale = Scale(Geometry=move_2.Geometry, Center=Point(0, 0, 0), Factor=expr("1/x", number_slider))  # -> Geometry, Transform
scale_2 = Scale(Geometry=move.Geometry, Center=Point(0, 0, 0), Factor=expr("1/x", number_slider))  # -> Geometry, Transform
robot_ik = RobotInverseKinematics(Robot=ur10, TargetTCPFrame=scale.Geometry, AxisToggles=[False, False, False], useColorPreview=True)  # -> PoseGeometry, AxisValues, AxisFrames
robot_ik_2 = RobotInverseKinematics(Robot=ur10, TargetTCPFrame=scale_2.Geometry, AxisToggles=[False, False, False], useColorPreview=True)  # -> PoseGeometry, AxisValues, AxisFrames
rad = Radians(Degrees=robot_ik.AxisValues)
rad_2 = Radians(Degrees=robot_ik_2.AxisValues)
joints = MotusJointState(Joints=rad, UseDegrees=False)
joints_2 = MotusJointState(Joints=rad_2, UseDegrees=False)
plan = MotusPlan(Robot=robot, Goal=joints, Start=joints_2)  # -> Trajectory, Status, Warnings
preview = MotusPreview(Trajectory=plan.Trajectory, ShowStart=False)  # -> Meshes, Links, TCPPath, State, Time, Index, Invalid
deconstruct_object = DeconstructObject(Object=preview.State, SchemaKeys="AxisCount|Positions", ShowDiagnostics=False, VisibleOutputs="AxisCount|Positions")  # -> AxisCount, Positions

# ---- group: Start State (continued)
deconstruct_object_2 = DeconstructObject(Object=joints_2, SchemaKeys="AxisCount|Positions", ShowDiagnostics=False, VisibleOutputs="AxisCount|Positions")  # -> AxisCount, Positions
deg = Degrees(Radians=deconstruct_object_2.Positions)
robot_fk = RobotForwardKinematics(Robot=ur10, AxisValues=deg, useColorPreview=True)  # -> PoseGeometry, TCPFrame, AxisFrames
scale_3 = Scale(Geometry=robot_fk.PoseGeometry, Center=Point(0, 0, 0), Factor=number_slider)  # -> Geometry, Transform

# ----
deg_2 = Degrees(Radians=deconstruct_object.Positions)
robot_fk_2 = RobotForwardKinematics(Robot=ur10, AxisValues=deg_2, useColorPreview=True)  # -> PoseGeometry, TCPFrame, AxisFrames
scale_4 = Scale(Geometry=robot_fk_2.PoseGeometry, Center=Point(0, 0, 0), Factor=Slider(0.001, range=0..0.001))  # -> Geometry, Transform
preview_2 = CustomPreview(Geometry=scale_4.Geometry, Material=ColourSwatch(SwatchColor=RGBA(196, 255, 214, 140)))
preview_3 = CustomPreview(Geometry=scale_3.Geometry, Material=ColourSwatch(SwatchColor=RGBA(255, 255, 255, 48)))
