# Grasshopper definition 01_quick_plan.ghx (Grasshopper 1.0.8)
# plug-ins: Motus
# Quick plan: sequential Joint State + TCP Pose LIN + Plane goal -> Preview / Export / Trajectory Data. Auto Plan on; drag Motus Scrub or Play.

c_script = CSharpScript()  # -> out, a
# ---------- c_script: C# ----------
// Grasshopper Script Instance
#region Usings
using System;
using System.IO;
using System.Linq;
using System.Collections;
using System.Collections.Generic;
using System.Drawing;

using Rhino;
using Rhino.Geometry;

using Grasshopper;
using Grasshopper.Kernel;
using Grasshopper.Kernel.Data;
using Grasshopper.Kernel.Types;
#endregion

public class Script_Instance : GH_ScriptInstance
{
    static string _opened;

    private void RunScript(object x, object y, ref object a)
    {
        var path = x as string;
        if (string.IsNullOrWhiteSpace(path))
        {
            a = "need path";
            return;
        }
        if (_opened == path)
        {
            a = "already " + Path.GetFileName(path);
            return;
        }
        if (!File.Exists(path)) { a = "missing"; return; }
        var io = new GH_DocumentIO();
        if (!io.Open(path)) { a = "open failed"; return; }
        Instances.DocumentServer.AddDocument(io.Document);
        if (Instances.ActiveCanvas != null)
            Instances.ActiveCanvas.Document = io.Document;
        _opened = path;
        a = "opened " + Path.GetFileName(path) + " objs=" + io.Document.ObjectCount;
    }
}
# ---------- end c_script ----------
Z = UnitZ(Factor=1)
goalpt = ConstructPoint(X=0.48, Y=0.18, Z=0.48)
joints = MotusJointState(Joints=[0, -0.5, 1, -1, 0, 0])
joints_2 = MotusJointState(Joints=[1.2, -1, 1.2, -1.6, -1.5708, 0])
ur10e = MotusUR10eRobotiq(ShowCollisionPreview=False)
pl = PlaneNormal(Origin=goalpt, ZAxis=Z)
tcp = MotusTCPPose(Robot=ur10e, State=joints_2)
quick = MotusPlan(
    Robot=ur10e,
    Goal=[joints_2, tcp, pl],
    Start=joints,
    Step=0.005,
    AutoPlan=True,
    ShowAttach=False,
    ShowCollision=False,
    ShowGroup=False,
    ShowRrtSettings=False)  # -> Trajectory, Status, Warnings
scrub = Slider(0, range=0..1)
preview = MotusPreview(
    Trajectory=quick.Trajectory,
    ShowStart=False,
    Position=scrub,
    ColorMode=0,
    ShowCustomColors=False,
    ShowDebugOutputs=False)  # -> Meshes, Links, TCPPath, State, Time
data = MotusTrajectoryData(Trajectory=quick.Trajectory)  # -> Planes, Times, Joints, ToolStates
export = MotusExport(Trajectory=quick.Trajectory, Retime=True, Validate=False)  # -> Json, Csv, Validation
