# Grasshopper definition 02_cartesian_planning.ghx (Grasshopper 1.0.8)
# plug-ins: Motus
# Cartesian TCP LIN: Joint State -> TCP Pose (FK plane) -> Plan. Click Plan, then Play on Preview.

model = ValueList({"KR 10 R1100", "KR 120 R2700", "KR 16 R2010", "KR 22 R1610", "KR 6 R900", "KR 60 R2100", "LBR iiwa 14 R820", "LBR iiwa 7 R800", "UR10e", "UR16e", "UR20", "UR30", "UR3e", "UR5e"}, selected="UR10e")
robot = MotusRobot(Model=model)
joints = MotusJointState(Joints=[1.2, -1, 1.2, -1.6, -1.5708, 0])
tcp = MotusTCPPose(Robot=robot, State=joints)
plan = MotusPlan(Robot=robot, Goal=tcp)  # -> Trajectory, Status, Warnings
preview = MotusPreview(Trajectory=plan.Trajectory, ShowStart=False)  # -> Meshes, Links, TCPPath, State, Time, Index, Invalid
