# Grasshopper definition 02_collision_planning.ghx (Grasshopper 1.0.0)

robot = MotusRobot()
joints = MotusJointState(Joints=[1.2, -1, 1.2, -1.6, -1.5708, 0])
colsph = MotusCollisionSphere(Center=Point(0.4, 0, 0.3), Radius=0.12)
colscene = MotusCollisionScene(Objects=colsph)
plan = MotusPlan(Robot=robot, Goal=joints, Collision=colscene)
preview = MotusPreview(Trajectory=plan)
