# Grasshopper definition 02_collision_srdf.ghx (Grasshopper 1.0.8)
# plug-ins: Motus
# Collision RRT: ColSphere + ColBox -> ColScene (SRDF) + Group + Attach + RRT Settings -> Plan. Wire ColMesh the same way as sphere/box. Auto Plan on.

c_script = CSharpScript()  # -> out, a
# ---------- c_script: C# ----------
// Grasshopper Script Instance
#region Usings
using System;
using System.IO;
using System.Linq;
using System.Collections;
using System.Collections.Generic;
using System.Drawing;

using Rhino;
using Rhino.Geometry;

using Grasshopper;
using Grasshopper.Kernel;
using Grasshopper.Kernel.Data;
using Grasshopper.Kernel.Types;
#endregion

public class Script_Instance : GH_ScriptInstance
{
    static string _openedKey;

    private void RunScript(object x, object y, ref object a)
    {
        var path = x as string;
        if (string.IsNullOrWhiteSpace(path)) { a = "need path"; return; }
        if (!File.Exists(path)) { a = "missing"; return; }
        var key = path + "|" + File.GetLastWriteTimeUtc(path).Ticks + "|" + (y?.ToString() ?? "");
        if (_openedKey == key) { a = "already " + Path.GetFileName(path); return; }
        var io = new GH_DocumentIO();
        if (!io.Open(path)) { a = "open failed"; return; }
        Instances.DocumentServer.AddDocument(io.Document);
        if (Instances.ActiveCanvas != null)
            Instances.ActiveCanvas.Document = io.Document;
        _openedKey = key;
        a = "opened " + Path.GetFileName(path) + " objs=" + io.Document.ObjectCount;
    }
}
# ---------- end c_script ----------
srdf = Panel("examples/srdf/table_base.srdf")
xy = XYPlane(Origin=Point(0, 0, 0))
goalpt = ConstructPoint(X=0.35, Y=0.15, Z=0.35)
goalpt_2 = ConstructPoint(X=0, Y=0, Z=0.08)
joints = MotusJointState(Joints=[1.2, -1, 1.2, -1.6, -1.5708, 0])
colsph = MotusCollisionSphere(Center=goalpt, Radius=0.12, Name="table")
colsph_2 = MotusCollisionSphere(Center=goalpt_2, Radius=0.05, Name="grasp")
ur10e = MotusUR10eRobotiq(ShowCollisionPreview=False)
attach = MotusAttachBody(Object=colsph_2, Name="grasp")
colbox = MotusCollisionBox(Plane=xy, HalfX=0.15, HalfY=0.08, HalfZ=0.4, Name="box")
planner = ValueList({"RrtConnect"}, selected="RrtConnect")
rrtset = MotusRRTSettings(TimeLimit=30, Planner=planner, GoalBias=0.08, Step=0.12)
colscene = MotusCollisionScene(Objects=[colsph, colbox], Srdf=srdf)  # -> Scene, Groups, EndEffectors
group = MotusPlanningGroup(Group=colscene.Groups, Name="manipulator", BaseLink="base_link", TipLink="tool0")
quick = MotusPlan(
    Robot=ur10e,
    Goal=joints,
    Step=0.005,
    Collision=colscene.Scene,
    Group=group,
    Attach=attach,
    RrtSettings=rrtset,
    AutoPlan=True,
    ShowAttach=True,
    ShowCollision=True,
    ShowGroup=True,
    ShowRrtSettings=True)  # -> Trajectory, Status, Warnings
scrub = Slider(0, range=0..1)
preview = MotusPreview(
    Trajectory=quick.Trajectory,
    ShowStart=False,
    Position=scrub,
    ColorMode=0,
    ShowCustomColors=False,
    ShowDebugOutputs=False)  # -> Meshes, Links, TCPPath, State, Time
