# Grasshopper definition 03_collision_rrt.ghx (Grasshopper 1.0.8)
# plug-ins: Motus
# Collision-aware RRT: ColSphere -> ColScene -> Plan.Collision with joint goal. Click Plan, then drag Motus Scrub or Play.

data = Data([Plane(origin=(0.6477354826, 0.5764566112, 0.7019347868), x=(0.1871870001, -0.9518211103, 0.2428942175), y=(-0.982123479, -0.1863369232, 0.02668375852)), Plane(origin=(0.486293471, 0.7834575486, 0.5041706698), x=(0.4490397279, -0.5495444175, 0.7045312313), y=(-0.8223279206, -0.5625847989, 0.0852944021)), Plane(origin=(0.3424554796, 0.8839913561, 0.3809567974), x=(0.3731286139, -0.1454275311, 0.916311012), y=(-0.6165169691, -0.7769089246, 0.12774721))])
crv = Curve(reparameterize([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]))
joints = MotusJointState(Joints=[1.2, -1, 1.2, -1.6, -1.5708, 0])
colsph = MotusCollisionSphere(Center=data, Radius=Slider(0.05, range=0..0.1), Name="sphere")
ur10e = MotusUR10eRobotiq()
mp = MultiPipe(Curves=crv, NodeSize=Slider(0.06, range=0..0.1), EndOffset=1, StrutSize=1, Segment=0, KinkAngle=0.6, CubeFit=0, Caps=1)
mesh = Mesh(mp)
meshsubd = MeshFromSubD(SubD=mp, Density=0)
colmesh = MotusCollisionMesh(Geometry=meshsubd, Plane=PlaneXY(0, 0, 0), Name="mesh")
colscene = MotusCollisionScene(Objects=colmesh)  # -> Scene, Groups, EndEffectors
plan = MotusPlan(
    Robot=ur10e,
    Goal=joints,
    Step=0.005,
    Collision=colscene.Scene,
    RrtMaxIter=4000,
    RrtTimeLimit=0,
    RrtPlanner="RrtConnect",
    RrtGoalBias=0.08,
    RrtStep=0.12,
    AutoPlan=False)  # -> Trajectory, Status, Warnings
data_2 = MotusTrajectoryData(Trajectory=plan.Trajectory)  # -> Planes, Times, Joints, ToolStates
panel = Panel(plan.Warnings)
item = ListItem(List=data_2.Planes, Index=[5, 16, 24], Wrap=True)
scrub = Slider(0.434, range=0..1)
preview = MotusPreview(Trajectory=plan.Trajectory, ShowStart=False, ColorMode=0, Position=0, ShowCustomColors=False)  # -> Meshes, Links, TCPPath, State, Time, Index, Invalid, ToolState, Width
