# Grasshopper definition 03_urdf_tool_frames.ghx (Grasshopper 1.0.8)
# plug-ins: Motus
# Motus Robot URDF + Base override + Robotiq Tool (Load Mesh, Cap=Robotiq2F85) + Start + Preview ShowStart. Auto Plan on.

c_script = CSharpScript()  # -> out, a
# ---------- c_script: C# ----------
// Grasshopper Script Instance
#region Usings
using System;
using System.IO;
using System.Linq;
using System.Collections;
using System.Collections.Generic;
using System.Drawing;

using Rhino;
using Rhino.Geometry;

using Grasshopper;
using Grasshopper.Kernel;
using Grasshopper.Kernel.Data;
using Grasshopper.Kernel.Types;
#endregion

public class Script_Instance : GH_ScriptInstance
{
    static string _openedKey;

    private void RunScript(object x, object y, ref object a)
    {
        var path = x as string;
        if (string.IsNullOrWhiteSpace(path)) { a = "need path"; return; }
        if (!File.Exists(path)) { a = "missing"; return; }
        var key = path + "|" + File.GetLastWriteTimeUtc(path).Ticks;
        if (_openedKey == key) { a = "already " + Path.GetFileName(path); return; }
        var io = new GH_DocumentIO();
        if (!io.Open(path)) { a = "open failed"; return; }
        Instances.DocumentServer.AddDocument(io.Document);
        if (Instances.ActiveCanvas != null)
            Instances.ActiveCanvas.Document = io.Document;
        _openedKey = key;
        a = "opened " + Path.GetFileName(path);
    }
}
# ---------- end c_script ----------
path = FilePath("/Users/lasaths/Documents/GitHub/Motus.Grasshopper/examples/ur10e/ur10e.urdf")
xy = XYPlane(Origin=Point(0, 0, 0))
goalpt = ConstructPoint(X=0, Y=0, Z=0.1633)
X = UnitX(Factor=1)
path_2 = FilePath("/Users/lasaths/Documents/GitHub/Motus.Grasshopper/resources/tools/robotiq_2f85_tcp_local.stl")
pl = PlaneNormal(Origin=goalpt, ZAxis=X)
capabilities = ValueList({"None", "Robotiq2F85"}, selected="None")
loadmesh = MotusLoadMesh(Path=path_2)
tool = MotusTool(Name="robotiq_2f85", TCP=pl, Geometry=loadmesh, Capabilities=capabilities)
robot = MotusRobot(Path=path, BaseLink="base_link", TipLink="tool0", Base=xy, Tool=tool, ShowCollisionPreview=False)
joints = MotusJointState(Joints=[0, -1.2, 1.2, -1.6, -1.5708, 0])
joints_2 = MotusJointState(Joints=[1.2, -1, 1.2, -1.6, -1.5708, 0])
quick = MotusPlan(
    Robot=robot,
    Goal=joints_2,
    Start=joints,
    Step=0.005,
    AutoPlan=True,
    ShowAttach=False,
    ShowCollision=False,
    ShowGroup=False,
    ShowRrtSettings=False)  # -> Trajectory, Status, Warnings
scrub = Slider(0, range=0..1)
preview = MotusPreview(Trajectory=quick.Trajectory, ShowStart=True, Position=scrub, ColorMode=0, ShowCustomColors=False, ShowDebugOutputs=False)  # -> Meshes, Links, TCPPath, State, Time
export = MotusExport(Trajectory=quick.Trajectory, Retime=True, Validate=False)  # -> Json, Csv, Validation
