# Grasshopper definition 04_motion_program.ghx (Grasshopper 1.0.8)
# plug-ins: Motus
# Motion program: PTP + LIN + CIRC + SET gripper -> Motus Program -> Preview / Export. Auto Plan on; drag Motus Scrub or Play.

c_script = CSharpScript()  # -> out, a
# ---------- c_script: C# ----------
// Grasshopper Script Instance
#region Usings
using System;
using System.IO;
using System.Linq;
using System.Collections;
using System.Collections.Generic;
using System.Drawing;

using Rhino;
using Rhino.Geometry;

using Grasshopper;
using Grasshopper.Kernel;
using Grasshopper.Kernel.Data;
using Grasshopper.Kernel.Types;
#endregion

public class Script_Instance : GH_ScriptInstance
{
    static string _openedKey;

    private void RunScript(object x, object y, ref object a)
    {
        var path = x as string;
        if (string.IsNullOrWhiteSpace(path)) { a = "need path"; return; }
        if (!File.Exists(path)) { a = "missing"; return; }
        var key = path + "|" + File.GetLastWriteTimeUtc(path).Ticks + "|" + (y?.ToString() ?? "");
        if (_openedKey == key) { a = "already"; return; }
        var io = new GH_DocumentIO();
        if (!io.Open(path)) { a = "open failed"; return; }
        Instances.DocumentServer.AddDocument(io.Document);
        if (Instances.ActiveCanvas != null)
            Instances.ActiveCanvas.Document = io.Document;
        _openedKey = key;
        a = "opened " + Path.GetFileName(path);
    }
}
# ---------- end c_script ----------
c_script_2 = CSharpScript()  # -> out, a; same code as c_script
preset = ValueList({"Open", "Closed", "Custom"}, selected="Open")
Z = UnitZ(Factor=1)
goalpt = ConstructPoint(X=0.45, Y=0.15, Z=0.45)
goalpt_2 = ConstructPoint(X=0.453, Y=0.152, Z=0.45)
goalpt_3 = ConstructPoint(X=0.45, Y=0.154, Z=0.45)
joints = MotusJointState(Joints=[0, -0.5, 1, -1, 0, 0])
joints_2 = MotusJointState(Joints=[1.2, -1, 1.2, -1.6, -1.5708, 0])
ur10e = MotusUR10eRobotiq(ShowCollisionPreview=False)
toolstate = MotusToolState(Tool=ur10e, Preset=preset, Width=0.085, Speed=0.5, Force=0.5)
move = MotusMove(Type="PTP", Goal=joints_2, Blend=0, ToolState=toolstate, MotionType="PTP", ToolMode="Hold")
preset_2 = ValueList({"Open", "Closed", "Custom"}, selected="Open")
pl = PlaneNormal(Origin=goalpt, ZAxis=Z)
move_2 = MotusMove(Type="LIN", Goal=pl, Blend=0, Step=0.005, MotionType="LIN", ToolMode="Hold")
pl_2 = PlaneNormal(Origin=goalpt_2, ZAxis=Z)
pl_3 = PlaneNormal(Origin=goalpt_3, ZAxis=Z)
move_3 = MotusMove(Type="CIRC", Goal=pl_3, Blend=0, Via=pl_2, MotionType="CIRC", ToolMode="Hold")
toolstate_2 = MotusToolState(Tool=ur10e, Preset=preset_2, Width=0.085, Speed=0.5, Force=0.5)
move_4 = MotusMove(Type="SET", ToolState=toolstate_2, Duration=0.2, MotionType="SET", ToolMode="Hold")
program = MotusProgram(Robot=ur10e, Segments=[move, move_2, move_3, move_4], Start=joints)  # -> Trajectory, Status, Warnings
export = MotusExport(Trajectory=program.Trajectory, Retime=True, Validate=False)  # -> Json, Csv, Validation
scrub = Slider(0, range=0..1)
preview = MotusPreview(
    Trajectory=program.Trajectory,
    ShowStart=False,
    Position=scrub,
    ColorMode=0,
    ShowCustomColors=False,
    ShowDebugOutputs=False)  # -> Meshes, Links, TCPPath, State, Time
