# Grasshopper definition 05_srdf_group_attach.ghx (Grasshopper 1.0.8)
# plug-ins: Motus
# SRDF allowed pairs + Planning Group + Attach Body on Plan. Set Srdf panel to your absolute path if needed.

model = ValueList({"KR 10 R1100", "KR 120 R2700", "KR 16 R2010", "KR 22 R1610", "KR 6 R900", "KR 60 R2100", "LBR iiwa 14 R820", "LBR iiwa 7 R800", "UR10e", "UR16e", "UR20", "UR30", "UR3e", "UR5e"}, selected="UR10e")
srdf = Panel("examples/srdf/table_base.srdf")
robot = MotusRobot(Model=model)
joints = MotusJointState(Joints=[1.2, -1, 1.2, -1.6, -1.5708, 0])
goalpt = ConstructPoint(X=0.35, Y=0.15, Z=0.35)
colsph = MotusCollisionSphere(Center=goalpt, Radius=0.12, Name="table")
goalpt_2 = ConstructPoint(X=0, Y=0, Z=0.08)
colsph_2 = MotusCollisionSphere(Center=goalpt_2, Radius=0.05, Name="grasp")
colscene = MotusCollisionScene(Objects=colsph, Srdf=srdf)  # -> Scene, Groups, EndEffectors
attach = MotusAttachBody(Object=colsph_2, Name="grasp")
group = MotusPlanningGroup(Group=colscene.Groups, Name="manipulator", BaseLink="base_link", TipLink="tool0")
plan = MotusPlan(Robot=robot, Goal=joints, Collision=colscene.Scene, Group=group, Attach=attach)  # -> Trajectory, Status, Warnings
preview = MotusPreview(Trajectory=plan.Trajectory, ShowStart=False)  # -> Meshes, Links, TCPPath, State, Time, Index, Invalid
