# Grasshopper definition 06_dkp_group.ghx (Grasshopper 1.0.8)
# plug-ins: Motus
# Prefab UR10e+Robotiq beside 2-DOF DKP: AllDrivers coupled Plan vs arm Group (locks DKP). Shared RRT scene; scrub both Previews.

# ---- group: Prefab UR10e + DKP
# 06  UR + DKP Group
path = FilePath("/Users/lasaths/Documents/GitHub/Motus.Grasshopper/resources/robots/ur10e_robotiq/ur10e_with_dkp.xacro")
joints = MotusJointState(Joints=[0, -1.2, 1.2, -1.6, -1.5708, 0, 0, 0])
joints_2 = MotusJointState(Joints=[1.2, -1, 1.2, -1.6, -1.5708, 0, 1, 0.35])
# Note: UR10e beside 2-axis DKP. AllDrivers on. Coupled: Group off (arm+DKP). Decoupled: arm Group locks DKP. Scrub both.
robot = MotusRobot(Path=path, BaseLink="world", TipLink="tool0", AllDrivers=True)

# ---- group: Scene + arm group
goalpt = ConstructPoint(X=2, Y=2, Z=0.4)
colsph = MotusCollisionSphere(Center=goalpt, Radius=0.08, Name="keepout")
colscene = MotusCollisionScene(Objects=colsph)  # -> Scene, Groups, EndEffectors
group = MotusPlanningGroup(
    Name="arm",
    BaseLink="base_link",
    TipLink="tool0",
    Joints=["shoulder_pan_joint", "shoulder_lift_joint", "elbow_joint", "wrist_1_joint", "wrist_2_joint", "wrist_3_joint"])
rrtset = MotusRRTSettings(MaxIter=4000, TimeLimit=30, Planner="RrtConnect", GoalBias=0.08, Step=0.12)

# ---- group: Coupled (arm+DKP)
quick = MotusPlan(
    Robot=robot,
    Goal=joints_2,
    Start=joints,
    Step=0.005,
    Collision=colscene.Scene,
    RrtSettings=rrtset,
    AutoPlan=True,
    ShowCollision=True,
    ShowGroup=False,
    ShowAttach=False,
    ShowRrtSettings=True)  # -> Trajectory, Status, Warnings
scrub = Slider(0, range=0..1)
preview = MotusPreview(Trajectory=quick.Trajectory, ShowStart=True, Position=scrub, ColorMode=0, ShowCustomColors=False, ShowDebugOutputs=False)  # -> Meshes, Links, TCPPath, State, Time

# ---- group: Decoupled (arm Group)
quick_2 = MotusPlan(
    Robot=robot,
    Goal=joints_2,
    Start=joints,
    Step=0.005,
    Collision=colscene.Scene,
    Group=group,
    RrtSettings=rrtset,
    AutoPlan=True,
    ShowCollision=True,
    ShowGroup=True,
    ShowAttach=False,
    ShowRrtSettings=True)  # -> Trajectory, Status, Warnings
scrub_2 = Slider(0, range=0..1)
preview_2 = MotusPreview(
    Trajectory=quick_2.Trajectory,
    ShowStart=True,
    Position=scrub_2,
    ColorMode=0,
    ShowCustomColors=False,
    ShowDebugOutputs=False)  # -> Meshes, Links, TCPPath, State, Time
