# Grasshopper definition 06_urdf_load.ghx (Grasshopper 1.0.8)
# plug-ins: Motus
# Motus Robot URDF load: bundled ur10e_robotiq.urdf path + explicit Start on Plan.

goal = Panel("""0
-80
0
-90
0
0""")
path = FilePath("resources/robots/ur10e_robotiq/ur10e_robotiq.urdf")
robot = MotusRobot(Path=path, BaseLink="base_link", TipLink="tool0")
start = Panel("""0
-90
0
-90
0
0""")
joints = MotusJointState(Joints=goal)
joints_2 = MotusJointState(Joints=start)
scrub = Slider(0, range=0..1)
quick = MotusPlan(
    Robot=robot,
    Goal=joints,
    Start=joints_2,
    Step=0.005,
    ShowCollision=False,
    ShowGroup=False,
    ShowAttach=False,
    ShowRrtSettings=False)  # -> Trajectory, Status, Warnings
preview = MotusPreview(Trajectory=quick.Trajectory, ShowStart=False, Position=scrub)  # -> Meshes, Links, TCPPath, State, Time
