# Grasshopper definition 07_frames_and_start.ghx (Grasshopper 1.0.8)
# plug-ins: Motus
# Motus Robot: URDF path + Base override + Motus Tool, explicit Start on Plan, ShowStart ghost on Preview.

path = FilePath("resources/robots/ur10e_robotiq/ur10e_robotiq.urdf")
xy = XYPlane()
xy_2 = XYPlane()
tool = MotusTool(Name="offset", TCP=xy_2, Capabilities="None")
robot = MotusRobot(Path=path, BaseLink="base_link", TipLink="tool0", Base=xy, Tool=tool)
joints = MotusJointState(Joints=[0, -1.2, 1.2, -1.6, -1.5708, 0])
joints_2 = MotusJointState(Joints=[1.2, -1, 1.2, -1.6, -1.5708, 0])
scrub = Slider(0, range=0..1)
quick = MotusPlan(
    Robot=robot,
    Goal=joints_2,
    Start=joints,
    Step=0.005,
    ShowCollision=False,
    ShowGroup=False,
    ShowAttach=False,
    ShowRrtSettings=False)  # -> Trajectory, Status, Warnings
preview = MotusPreview(Trajectory=quick.Trajectory, ShowStart=True, Position=scrub)  # -> Meshes, Links, TCPPath, State, Time
