# Grasshopper definition 08_stewart_tcp_path.ghx (Grasshopper 1.0.8)
# plug-ins: Motus
# Sliders Br/Pr/Lmin/Lmax → Motus Stewart → dramatic multi-waypoint TCP loop (heave/sway) → Preview + Waypoints (leg lengths in meters). Wire Base+Plat for custom anchors.

# ---- group: Stewart
# 08 · Stewart TCP path
# Note: Sliders → Stewart → Plan TCP loop (heave + sway, ~±80 mm / ±100 mm Z) → Preview. Q = leg lengths (m). Drag Br/Pr; keep Lmin/Lmax if Status hits StrokeLimit.
br = Slider(0.5, range=0.2..0.8)
pr = Slider(0.3, range=0.1..0.6)
lmin = Slider(0.35, range=0.2..0.6)
lmax = Slider(0.9, range=0.5..1.2)
stewart = MotusStewart(BaseRadius=br, PlatformRadius=pr, MinStroke=lmin, MaxStroke=lmax, Name="stewart_classic", PairSep=0.15)

# ---- group: Plan TCP
Z = UnitZ()
goalpt = ConstructPoint(X=0, Y=0, Z=0.62)
goalpt_2 = ConstructPoint(X=0.08, Y=0.02, Z=0.7)
goalpt_3 = ConstructPoint(X=0.02, Y=0.1, Z=0.52)
goalpt_4 = ConstructPoint(X=-0.08, Y=0.04, Z=0.68)
goalpt_5 = ConstructPoint(X=-0.04, Y=-0.08, Z=0.55)
goalpt_6 = ConstructPoint(X=0.06, Y=-0.06, Z=0.62)
goalpt_7 = ConstructPoint(X=0, Y=0, Z=0.62)
pl = PlaneNormal(Origin=goalpt, ZAxis=Z)
pl_2 = PlaneNormal(Origin=goalpt_2, ZAxis=Z)
pl_3 = PlaneNormal(Origin=goalpt_3, ZAxis=Z)
pl_4 = PlaneNormal(Origin=goalpt_4, ZAxis=Z)
pl_5 = PlaneNormal(Origin=goalpt_5, ZAxis=Z)
pl_6 = PlaneNormal(Origin=goalpt_6, ZAxis=Z)
pl_7 = PlaneNormal(Origin=goalpt_7, ZAxis=Z)
merge = Merge(Data1=pl_2, Data2=pl_3, Data3=pl_4, Data4=pl_5, Data5=pl_6, Data6=pl_7)
quick = MotusPlan(
    Robot=stewart,
    Goal=merge,
    Start=pl,
    Step=0.005,
    AutoPlan=True,
    ShowCollision=False,
    ShowGroup=False,
    ShowAttach=False,
    ShowRrtSettings=False)  # -> Trajectory, Status, Warnings
waypoints = MotusWaypoints(Trajectory=quick.Trajectory, Decimate=1)  # -> Joints, Planes, Times

# ---- group: Preview
scrub = Slider(0, range=0..1)
preview = MotusPreview(Trajectory=quick.Trajectory, ShowStart=True, Position=scrub, ColorMode=0, ShowCustomColors=False, ShowDebugOutputs=False)  # -> Meshes, Links, TCPPath, State, Time
