# Grasshopper definition 09_tool_tcp.ghx (Grasshopper 1.0.8)
# plug-ins: Motus
# Motus Tool (TCP + gripper box) -> Robot.Tool -> Plan -> Preview/Export. Mesh tools fall back from FCL.

model = ValueList({"KR 10 R1100", "KR 120 R2700", "KR 16 R2010", "KR 22 R1610", "KR 6 R900", "KR 60 R2100", "LBR iiwa 14 R820", "LBR iiwa 7 R800", "UR10e", "UR16e", "UR20", "UR30", "UR3e", "UR5e"}, selected="UR10e")
xy = XYPlane()
colbox = MotusCollisionBox(HalfX=0.02, HalfY=0.02, HalfZ=0.04, Name="gripper_geom")
tool = MotusTool(Name="gripper", TCP=xy, Geometry=colbox)
robot = MotusRobot(Model=model, Tool=tool)
joints = MotusJointState(Joints=[1.2, -1, 1.2, -1.6, -1.5708, 0])
plan = MotusPlan(Robot=robot, Goal=joints)  # -> Trajectory, Status, Warnings
preview = MotusPreview(Trajectory=plan.Trajectory, ShowStart=False)  # -> Meshes, Links, TCPPath, State, Time, Index, Invalid
export = MotusExport(Trajectory=plan.Trajectory)  # -> Json, Csv
