# Grasshopper definition 09_walking_hexapod.ghx (Grasshopper 1.0.8)
# plug-ins: Motus, Cassis
# Walking hexapod: arc plane list → WalkHex foot-target IK gait Trajectory (18-DOF + mobile base) → Motus Preview + Scrub. Not Stewart; no Motus Plan on gait path.

# ---- group: Walking Hex path
goalpt = ConstructPoint(X=0.05, Y=4.29e-17, Z=0)
goalpt_2 = ConstructPoint(X=0.07664216362, Y=0.1339392013, Z=0)
goalpt_3 = ConstructPoint(X=0.1525126266, Y=0.2474873734, Z=0)
goalpt_4 = ConstructPoint(X=0.2660607987, Y=0.3233578364, Z=0)
goalpt_5 = ConstructPoint(X=0.4, Y=0.35, Z=0)
goalpt_6 = ConstructPoint(X=0.5339392013, Y=0.3233578364, Z=0)
goalpt_7 = ConstructPoint(X=0.6474873734, Y=0.2474873734, Z=0)
goalpt_8 = ConstructPoint(X=0.7233578364, Y=0.1339392013, Z=0)
goalpt_9 = ConstructPoint(X=0.75, Y=0, Z=0)
# 09 · Walking hexapod
# Note: WalkHex Planes → foot-target IK gait Trajectory → Preview + Scrub. Body follows arc; feet plant at Z=0 — no Motus Plan on this path.
Z = UnitZ(Factor=1)
pl = PlaneNormal(Origin=goalpt, ZAxis=Z)
pl_2 = PlaneNormal(Origin=goalpt_2, ZAxis=Z)
pl_3 = PlaneNormal(Origin=goalpt_3, ZAxis=Z)
pl_4 = PlaneNormal(Origin=goalpt_4, ZAxis=Z)
pl_5 = PlaneNormal(Origin=goalpt_5, ZAxis=Z)
pl_6 = PlaneNormal(Origin=goalpt_6, ZAxis=Z)
pl_7 = PlaneNormal(Origin=goalpt_7, ZAxis=Z)
pl_8 = PlaneNormal(Origin=goalpt_8, ZAxis=Z)
pl_9 = PlaneNormal(Origin=goalpt_9, ZAxis=Z)
merge = Merge(Data1=pl, Data2=pl_2, Data3=pl_3, Data4=pl_4, Data5=pl_5, Data6=pl_6, Data7=pl_7, Data8=pl_8, Data9=pl_9)
walkhex = MotusWalkingHex(
    BodyR=0.12,
    Coxa=0.06,
    Femur=0.17,
    Tibia=0.19,
    HipStance=0.1309,
    FemurStance=0.5236,
    TibiaStance=-0.5236,
    BodyZ=0.12,
    Planes=merge,
    Speed=0.08,
    Step=0.06,
    Lift=0.03,
    ShowCollisionPreview=False)  # -> Robot, State, Trajectory, PathCurve, PathPlanes, Meshes, Support

# ----
cassis = Cassis(
    Prefix="http://localhost:3003/mcp/",
    EnabledTools="Add_CSharp_Script_Component,Edit_Script,List_Python_Scripts,Edit_Python_Script,Edit_CSharp_Script,Get_Python_Script_Errors,Get_CSharp_Script_Errors,Get_Python_Script,Get_CSharp_Script,Get_AllComponents,Get_ComponentCount,Get_Component_Output,GetAllConnections,List_Panels,Get_Panel_Text,Set_Panel_Text,Get_Components_In_Group,AddComponent,GetSolutionState,Orbit_Object,Capture_Viewport,List_Viewports,Manage_NamedViews,GetDetailedComponentInfo,Set_Component_Enabled,Set_Component_Preview,Get_Component_State,LoadDocument,SaveDocument,CloseDocument,GetDocumentInfo,ListOpenDocuments,Canvas_Snapshot,List_CSharp_Scripts,Move_Component,Set_Component_Value,GetDetailedComponentInfoById,Modify_Script_Component_Parameters,Add_Script_Parameter,Remove_Script_Parameter,Get_Parameter_TypeHints,Connect_Components_By_Name,ConnectComponentsWithValidation,ValidateConnection,Connect_Components,ReconnectByName,Toggle_BooleanToggle,ForceDocumentSolution,ExpireComponent,RecomputeScriptComponents,Toggle_SolverExecute,Toggle_SolverReset,Capture_Canvas,Save_HiRes_Canvas,NewDocument,GetSystemHealth,RunHealthCheck,ListHealthChecks,CreateGrasshopperDefinition,OptimizeGrasshopperDefinition,TroubleshootGrasshopper,LearnGrasshopperConcept,AnalyzeGrasshopperDefinition,Create_ABxM_Behavior_Prompt,Create_RADr_Behavior_Template")

# ---- group: Gait Preview
scrub = Slider(0.741, range=0..1)
preview = MotusPreview(
    Trajectory=walkhex.Trajectory,
    ShowStart=True,
    Position=scrub,
    ColorMode=0,
    ShowCustomColors=False,
    ShowDebugOutputs=False)  # -> Meshes, Links, TCPPath, State, Time
