# Grasshopper definition 10_funky_octopod.ghx (Grasshopper 1.0.8)
# plug-ins: Motus
# N=8 radial walker: Body+Leg+Mechanism → Walk (ADR 0005). Flat ground (no Tn).

# 10 · Funky octopod
# Note: Body N=8 + Leg → Mechanism → Walk. Same stack as 09 — no Hex special case. Auto crawl/wave from Motus.NET GaitSchedule.
Z = UnitZ()
goalpt = ConstructPoint(X=0.09, Y=1.96e-17, Z=0)
goalpt_2 = ConstructPoint(X=0.1114359354, Y=0.08, Z=0)
goalpt_3 = ConstructPoint(X=0.17, Y=0.1385640646, Z=0)
goalpt_4 = ConstructPoint(X=0.25, Y=0.16, Z=0)
goalpt_5 = ConstructPoint(X=0.33, Y=0.1385640646, Z=0)
goalpt_6 = ConstructPoint(X=0.3885640646, Y=0.08, Z=0)
goalpt_7 = ConstructPoint(X=0.41, Y=0, Z=0)
pl = PlaneNormal(Origin=goalpt, ZAxis=Z)
pl_2 = PlaneNormal(Origin=goalpt_2, ZAxis=Z)
pl_3 = PlaneNormal(Origin=goalpt_3, ZAxis=Z)
pl_4 = PlaneNormal(Origin=goalpt_4, ZAxis=Z)
pl_5 = PlaneNormal(Origin=goalpt_5, ZAxis=Z)
pl_6 = PlaneNormal(Origin=goalpt_6, ZAxis=Z)
pl_7 = PlaneNormal(Origin=goalpt_7, ZAxis=Z)
body = MotusBody(N=8, BodyR=0.08, BodyZ=0.07)
leg = MotusLeg(Name="leg")
merge = Merge(Data1=pl, Data2=pl_2, Data3=pl_3, Data4=pl_4, Data5=pl_5, Data6=pl_6, Data7=pl_7)
mech = MotusMechanism(Body=body, Leg=leg, AllowDynamicGait=False, HipStance=0.1309, FemurStance=0.5236, TibiaStance=-0.5236)
walk = MotusWalk(Mechanism=mech, Planes=merge, Speed=0.06, Step=0.04, Lift=0.02)  # -> Robot, State, Trajectory, PathCurve, PathPlanes, Meshes, Support
scrub = Slider(0, range=0..1)
preview = MotusPreview(Trajectory=walk.Trajectory, ShowStart=True, Position=scrub, ColorMode=0, ShowCustomColors=False, ShowDebugOutputs=False)  # -> Meshes, Links, TCPPath, State, Time
