# Grasshopper definition 10_pick_place.ghx (Grasshopper 1.0.8)
# plug-ins: Motus, Cassis
# UR10e destack 5×4 rotating tower → 5 columns × 4 via Motus Pick Place (one Program). Z-down home; SET open 0.085 / close 0.04. PickPlace Touch=robotiq_2f85. Plan ColScene = table only.

goalpt = ConstructPoint(X=0.7, Y=-0.25, Z=0.48)
goalpt_2 = ConstructPoint(X=0.7, Y=0, Z=0.48)
c_script = CSharpScript()  # -> out, a
# ---------- c_script: C# ----------
// Grasshopper Script Instance
#region Usings
using System;
using System.Collections.Generic;
#endregion

public class Script_Instance : GH_ScriptInstance
{
    private void RunScript(ref object a)
    {
        // Fingers-down for Robotiq mesh (fingers along −Motus approach):
        // Motus X = world +Z → Rhino TCP Z = +Z. J5 = −π/2 (was +π/2 → fingers up).
        a = new List<double> { 0, -Math.PI / 2, Math.PI / 2, -Math.PI / 2, -Math.PI / 2, 0 };
    }
}
# ---------- end c_script ----------

# ---- group: Robot + Z-down home
# 10  Tower destack
ur10e = MotusUR10eRobotiq(ShowCollisionPreview=False, ShowTcp=False)
joints = MotusJointState(Joints=c_script.a)
# Note: 5×4 rotating tower → 5 columns × 4. Layout = C# script (not Motus Tower). Grasp/place TCP Z = world +Z (Robotiq fingers world −Z). SET open 0.085 / close 0.04. PickPlace Touch=robotiq_2f85. Plan ColScene = table only.
tcp = MotusTCPPose(Robot=ur10e, State=joints)

# ----
c_script_2 = CSharpScript(Tower=goalpt_2, Columns=goalpt)  # -> out, Brick, Grasp, Place, Dimensions; inputs Tower: Point3d, Columns: Point3d, Levels: Double, HalfX: Double, HalfY: Double, HalfZ: Double, ColPitch: Double, ColumnsN: Double
# ---------- c_script_2: C# ----------
#region Usings
using System;
using System.Collections.Generic;
using Rhino.Geometry;
using Grasshopper;
using Grasshopper.Kernel;
using Grasshopper.Kernel.Data;
#endregion

public class Script_Instance : GH_ScriptInstance
{
    private void RunScript(
		Point3d Tower,
		Point3d Columns,
		double Levels,
		double HalfX,
		double HalfY,
		double HalfZ,
		double ColPitch,
		double ColumnsN,
		ref object Brick,
		ref object Grasp,
		ref object Place,
		ref object Dimensions)
    {
        if (HalfX <= 0.0) HalfX = 0.03;
        if (HalfY <= 0.0) HalfY = 0.01;
        if (HalfZ <= 0.0) HalfZ = 0.01;
        if (ColPitch <= 0.0) ColPitch = 0.10;

        int levels = Math.Max(
            1,
            (int)Math.Round(Levels <= 0.0 ? 5.0 : Levels)
        );

        int columnsN = Math.Max(
            1,
            (int)Math.Round(ColumnsN <= 0.0 ? 5.0 : ColumnsN)
        );

        const int perLevel = 2;
        const int stackHeight = 4;

        int total = levels * perLevel;

        if (columnsN * stackHeight < total)
        {
            Component.AddRuntimeMessage(
                GH_RuntimeMessageLevel.Error,
                "Not enough destination column capacity."
            );

            return;
        }

        List<Plane> bricks = new List<Plane>(total);
        List<Plane> grasps = new List<Plane>(total);
        List<Plane> places = new List<Plane>(total);

        DataTree<double> dimensions =
            new DataTree<double>();

        double blockX = HalfX * 2.0;
        double blockY = HalfY * 2.0;
        double blockZ = HalfZ * 2.0;

        double cell = blockX / 3.0;
        double offset = cell;

        int blockIndex = 0;

        for (int level = levels - 1; level >= 0; level--)
        {
            double z =
                Tower.Z
                + HalfZ
                + level * 2.0 * HalfZ;

            Point3d center = new Point3d(
                Tower.X,
                Tower.Y,
                z
            );

            bool rotate = level % 2 == 1;

            if (!rotate)
            {
                Point3d a =
                    center
                    + Vector3d.YAxis * offset;

                Point3d b =
                    center
                    - Vector3d.YAxis * offset;

                Plane brickA = new Plane(
                    a,
                    Vector3d.XAxis,
                    Vector3d.YAxis
                );

                Plane brickB = new Plane(
                    b,
                    Vector3d.XAxis,
                    Vector3d.YAxis
                );

                bricks.Add(brickA);
                bricks.Add(brickB);

                grasps.Add(
                    FingersDownTcp(
                        a,
                        Vector3d.YAxis
                    )
                );

                grasps.Add(
                    FingersDownTcp(
                        b,
                        Vector3d.YAxis
                    )
                );

                AddDimensions(
                    dimensions,
                    blockIndex++,
                    blockX,
                    blockY,
                    blockZ
                );

                AddDimensions(
                    dimensions,
                    blockIndex++,
                    blockX,
                    blockY,
                    blockZ
                );
            }
            else
            {
                Point3d a =
                    center
                    + Vector3d.XAxis * offset;

                Point3d b =
                    center
                    - Vector3d.XAxis * offset;

                Plane brickA = new Plane(
                    a,
                    Vector3d.YAxis,
                    -Vector3d.XAxis
                );

                Plane brickB = new Plane(
                    b,
                    Vector3d.YAxis,
                    -Vector3d.XAxis
                );

                bricks.Add(brickA);
                bricks.Add(brickB);

                grasps.Add(
                    FingersDownTcp(
                        a,
                        -Vector3d.XAxis
                    )
                );

                grasps.Add(
                    FingersDownTcp(
                        b,
                        -Vector3d.XAxis
                    )
                );

                AddDimensions(
                    dimensions,
                    blockIndex++,
                    blockX,
                    blockY,
                    blockZ
                );

                AddDimensions(
                    dimensions,
                    blockIndex++,
                    blockX,
                    blockY,
                    blockZ
                );
            }
        }

        for (int i = 0; i < total; i++)
        {
            int col = i / stackHeight;
            int height = i % stackHeight;

            double z =
                Columns.Z
                + HalfZ
                + height * 2.0 * HalfZ;

            Point3d origin = new Point3d(
                Columns.X,
                Columns.Y - col * ColPitch,
                z
            );

            places.Add(
                FingersDownTcp(
                    origin,
                    Vector3d.YAxis
                )
            );
        }

        Brick = bricks;
        Grasp = grasps;
        Place = places;
        Dimensions = dimensions;
    }

    private void AddDimensions(
        DataTree<double> tree,
        int index,
        double x,
        double y,
        double z)
    {
        GH_Path path = new GH_Path(index);

        tree.Add(x, path);
        tree.Add(y, path);
        tree.Add(z, path);
    }

    private Plane FingersDownTcp(
        Point3d origin,
        Vector3d shortAxis)
    {
        Vector3d y = new Vector3d(
            shortAxis.X,
            shortAxis.Y,
            0.0
        );

        if (!y.Unitize())
            y = Vector3d.YAxis;

        Vector3d x = Vector3d.CrossProduct(
            y,
            Vector3d.ZAxis
        );

        if (!x.Unitize())
            x = Vector3d.XAxis;

        x = -x;
        y = -y;

        return new Plane(
            origin,
            x,
            y
        );
    }
}
# ---------- end c_script_2 ----------
bang = ExplodeTree(Data=c_script_2.Dimensions)
item = ListItem(List=bang, Index=0, Wrap=True)  # -> flatten(Item), flatten(Item1), flatten(Item2)
multiplication = Multiplication(A=item.Item1, B=1.5)
boxes = MotusCollisionBoxes(
    Planes=c_script_2.Brick,
    HalfX=expr("x/2", item.Item),
    HalfY=expr("x/2", item.Item1),
    HalfZ=expr("x/2", item.Item2),
    Prefix="b")  # -> flatten(Objects)

# ---- group: Table + scenes
Z = UnitZ(Factor=1)
goalpt_3 = ConstructPoint(X=0.7, Y=-0.2, Z=0.46)
pl = PlaneNormal(Origin=goalpt_3, ZAxis=Z)
colbox = MotusCollisionBox(Plane=pl, HalfX=0.22, HalfY=0.5, HalfZ=0.02, Name="table")
merge = Merge(Data1=flatten(boxes), Data2=flatten(colbox))
colscene = MotusCollisionScene(Objects=colbox)  # -> Scene, Groups, EndEffectors
colscene_2 = MotusCollisionScene(Objects=merge)  # -> Scene, Groups, EndEffectors

# ----
colscene_3 = MotusCollisionScene()  # -> Scene, Groups, EndEffectors

# ---- group: Pick Place → Program
pickplace = MotusPickPlace(
    Grasp=c_script_2.Grasp,
    Place=c_script_2.Place,
    Objects=boxes,
    Approach=0.08,
    Wopen=multiplication,
    Wclose=item.Item1,
    Step=0.005,
    SamplingTransfers=False,
    TouchBodies="robotiq_2f85")
program = MotusProgram(Robot=ur10e, Segments=pickplace, Start=joints, Collision=colscene_3.Scene, AutoPlan=True)  # -> Trajectory, Status, Warnings

# ---- group: Preview
scrub = Slider(1, range=0..1)
preview = MotusPreview(
    Trajectory=program.Trajectory,
    ShowStart=True,
    Position=scrub,
    Scene=colscene_2.Scene,
    ColorMode=0,
    ShowCustomColors=False,
    ShowDebugOutputs=False,
    ShowPath=True,
    ShowTcp=False)  # -> Meshes, Links, TCPPath, State, Time

# ----
cassis = Cassis(
    Prefix="http://localhost:3003/mcp/",
    EnabledTools="List_CSharp_Scripts,Get_CSharp_Script,Edit_CSharp_Script,Get_CSharp_Script_Errors,List_Python_Scripts,Get_Python_Script,Edit_Python_Script,Get_Python_Script_Errors,Edit_Script,Get_AllComponents,Get_ComponentCount,Get_Component_Output,GetAllConnections,List_Panels,Get_Panel_Text,Set_Panel_Text,Get_Components_In_Group,AddComponent,GetSolutionState,Orbit_Object,Capture_Viewport,List_Viewports,Manage_NamedViews,Get_Parameter_TypeHints,Set_Component_Enabled,Set_Component_Preview,Get_Component_State,LoadDocument,SaveDocument,CloseDocument,GetDocumentInfo,ListOpenDocuments,Canvas_Snapshot,Add_CSharp_Script_Component,Modify_Script_Component_Parameters,Add_Script_Parameter,Remove_Script_Parameter,GetDetailedComponentInfo,GetDetailedComponentInfoById,Set_Component_Value,Move_Component,Connect_Components_By_Name,ConnectComponentsWithValidation,ValidateConnection,Connect_Components,ReconnectByName,Toggle_BooleanToggle,ForceDocumentSolution,ExpireComponent,RecomputeScriptComponents,Toggle_SolverExecute,Toggle_SolverReset,Capture_Canvas,Save_HiRes_Canvas,NewDocument,GetSystemHealth,RunHealthCheck,ListHealthChecks,CreateGrasshopperDefinition,OptimizeGrasshopperDefinition,TroubleshootGrasshopper,LearnGrasshopperConcept,AnalyzeGrasshopperDefinition")
