# Grasshopper definition 10_robotiq_tool.ghx (Grasshopper 1.0.8)
# plug-ins: Motus
# Explicit Robotiq mesh path (Motus Robot already bundles gripper for UR10e by default).

model = ValueList({"KR 10 R1100", "KR 120 R2700", "KR 16 R2010", "KR 22 R1610", "KR 6 R900", "KR 60 R2100", "LBR iiwa 14 R820", "LBR iiwa 7 R800", "UR10e", "UR16e", "UR20", "UR30", "UR3e", "UR5e"}, selected="UR10e")
goalpt = ConstructPoint(X=0, Y=0, Z=0.1633)
X = UnitX()
path = FilePath("examples/ur10e/meshes/robotiq_2f85/robotiq_2f85_tcp_local.stl")
goal = Plane(Origin=goalpt, Normal=X)
loadmesh = MotusLoadMesh(Path=path)
tool = MotusTool(Name="robotiq_2f85", TCP=goal, Geometry=loadmesh)
robot = MotusRobot(Model=model, Tool=tool)
joints = MotusJointState(Joints=[1.2, -1, 1.2, -1.6, -1.5708, 0])
plan = MotusPlan(Robot=robot, Goal=joints)  # -> Trajectory, Status, Warnings
preview = MotusPreview(Trajectory=plan.Trajectory, ShowStart=False)  # -> Meshes, Links, TCPPath, State, Time, Index, Invalid
