# Grasshopper definition 11_aerial_hover.ghx (Grasshopper 1.0.8)
# plug-ins: Motus
# Free-flyer HolonomicSE3: Motus Robot (assets/aerial/free_flyer_box.urdf) Start/Goal WorldXY planes → Plan → Preview / Export / Waypoints. Auto Plan. Motus 2.1 ADR 0006.

# ----
# 11 · Aerial hover
# Free-flyer HolonomicSE3 Start→Goal. Auto Plan. bodyPose ≠ MoveJ.
# Robot
flyerurdf = Panel("assets/aerial/free_flyer_box.urdf")
robot = MotusRobot(Path=flyerurdf, BaseLink="body", TipLink="body", AllDrivers=False)

# ----
# Env + Traj
Z = UnitZ()
goalpt = ConstructPoint(X=-0.5, Y=0.35, Z=0.55)
goalpt_2 = ConstructPoint(X=0.45, Y=-0.25, Z=1.05)
pl = PlaneNormal(Origin=goalpt, ZAxis=Z)
pl_2 = PlaneNormal(Origin=goalpt_2, ZAxis=Z)

# ----
# Plan
quick = MotusPlan(
    Robot=robot,
    Goal=pl_2,
    Start=pl,
    Step=0.005,
    AutoPlan=True,
    ShowCollision=False,
    ShowGroup=False,
    ShowAttach=False,
    ShowRrtSettings=False)  # -> Trajectory, Status, Warnings

# ----
# Play
scrub = Slider(0, range=0..1)
preview = MotusPreview(Trajectory=quick.Trajectory, ShowStart=True, Position=scrub, ColorMode=0, ShowCustomColors=False, ShowDebugOutputs=False)  # -> Meshes, Links, TCPPath, State, Time
waypoints = MotusWaypoints(Trajectory=quick.Trajectory, Decimate=1)  # -> Joints, Planes, Times
export = MotusExport(Trajectory=quick.Trajectory, Retime=True, Validate=False, Retimer="TotgLite")  # -> Json, Csv, Validation
