# Grasshopper definition 11_gripper_motion_program.ghx (Grasshopper 1.0.8)
# plug-ins: Motus
# Motion program with SET gripper close: UR10e Robotiq -> Program Plan -> Preview/Export (toolState on trajectory).

ur10e = MotusUR10eRobotiq()
joints = MotusJointState(Joints=[0, -0.5, 1, -1, 0, 0])
joints_2 = MotusJointState(Joints=[0, -0.5, 1, -1, 0, 0])
toolstate = MotusToolState(Preset="Open", Width=0.085, Speed=0.5, Force=0.5)
toolstate_2 = MotusToolState(Preset="Closed", Width=0.085, Speed=0.5, Force=0.5)
segment = MotusMotionSegment(Type="PTP", Goal=joints_2, Step=0.005, Samples=16, Blend=0, ToolState=toolstate, ToolMode="Hold", Duration=0)
segment_2 = MotusMotionSegment(Type="SET", Step=0.005, Samples=16, Blend=0, ToolState=toolstate_2, ToolMode="Hold", Duration=0.2)
scrub = Slider(0, range=0..1)
progplan = MotusProgramPlan(Robot=ur10e, Segments=[segment, segment_2], Start=joints)  # -> Trajectory, Status, Warnings
preview = MotusPreview(Trajectory=progplan.Trajectory, ShowStart=False, Position=scrub)  # -> Meshes, Links, TCPPath, State, Time, Index, Invalid, ToolState, Width
export = MotusExport(Trajectory=progplan.Trajectory, Retime=True, Validate=False)  # -> Json, Csv, Validation
