# Grasshopper definition 12_bamboo_truss_assembly.ghx (Grasshopper 1.0.8)
# plug-ins: Motus
# Bamboo Warren truss assembly (Motus.Construction): Rhino lines + supports → Motus Assembly Structure / Site → Motus Assembly Plan (assets/icd/bamboo_icd.urdf; Run toggle, background) → Motus Assembly Preview (t). Needs the Motus.NET sibling build (Motus.Construction). Planning / preview only.

# ----
# 12 · Bamboo truss assembly
# Warren truss lines (Rhino) → Assembly Structure + Site → Assembly Plan (Run) → Assembly Preview (t). Planning / preview only.
# Structure
warren = Line([Line((-0.3, -0.11, 0.19), (0, -0.11, 0.19)), Line((-0.3, -0.11, 0.19), (-0.15, -0.11, 0.449807621)), Line((-0.15, -0.11, 0.449807621), (0, -0.11, 0.19)), Line((0, -0.11, 0.19), (0.15, -0.11, 0.449807621)), Line((-0.15, -0.11, 0.449807621), (0.15, -0.11, 0.449807621)), Line((0, -0.11, 0.19), (0.3, -0.11, 0.19)), Line((0.15, -0.11, 0.449807621), (0.3, -0.11, 0.19))])
nodes = Point([Point(-0.3, -0.11, 0.19), Point(0, -0.11, 0.19), Point(0.3, -0.11, 0.19), Point(-0.15, -0.11, 0.449807621), Point(0.15, -0.11, 0.449807621)])
astruct = MotusAssemblyStructure(Members=warren, Nodes=nodes, Names=["A", "M", "D", "T1", "T2"])  # -> Structure, Ids

# ----
# Site
supports = Point([Point(-0.3, -0.11, 0.19), Point(0.3, -0.11, 0.19)])
asite = MotusAssemblySite(Supports=supports)

# ----
# Plan
urdf = Panel("assets/icd/bamboo_icd.urdf")
run = BooleanToggle(False)
aplan = MotusAssemblyPlan(
    Structure=astruct.Structure,
    Site=asite,
    Robot=urdf,
    Margin=0.002,
    Shipped=True,
    Run=run,
    Stability=False,
    RobotMass=1,
    Certified=False,
    Layer=False)  # -> Plan, Tasks, Verdict, CollisionFree
verdict = Panel(aplan.Verdict)

# ----
# Play
t = Slider(0, range=0..1)
aprev = MotusAssemblyPreview(Plan=aplan.Plan, Time=t)  # -> Robot, Placed, Active, Task, Holding
task = Panel(aprev.Task)
