# Grasshopper definition 12_icd_collective_actuator.ghx (Grasshopper 1.0.8)
# plug-ins: Motus
# ICD collective robotic construction actuator (Samuel Leder, ICD/Stuttgart): URDF (1 revolute + 2 grippers) → Joint-linear rotation (0 → π rad) → Preview scrub. Conservative demo motion; hardware has unlimited rotation. 50×50mm timber struts (not shown). Planning/preview only.

# ----
# 12 · ICD Collective Actuator
# ICD timber actuator (1 revolute + 2 grippers). Joint-linear rotation → Preview. Conservative limits labeled as assumption.
# Robot
urdf = Panel("assets/icd/collective_actuator.urdf")
robot = MotusRobot(Path=urdf, BaseLink="base_link", TipLink="tool0", AllDrivers=False)

# ----
# Env + Traj
joints = MotusJointState(Joints=0)
joints_2 = MotusJointState(Joints=3.141592654)

# ----
# Plan
quick = MotusPlan(
    Robot=robot,
    Goal=joints_2,
    Start=joints,
    Step=0.005,
    AutoPlan=True,
    ShowCollision=False,
    ShowGroup=False,
    ShowAttach=False,
    ShowRrtSettings=False)  # -> Trajectory, Status, Warnings

# ----
# Play
scrub = Slider(0, range=0..1)
preview = MotusPreview(Trajectory=quick.Trajectory, ShowStart=True, Position=scrub, ColorMode=0, ShowCustomColors=False, ShowDebugOutputs=False)  # -> Meshes, Links, TCPPath, State, Time
waypoints = MotusWaypoints(Trajectory=quick.Trajectory, Decimate=1)  # -> Joints, Planes, Times
