# Grasshopper definition 12_sequential_goals.ghx (Grasshopper 1.0.8)
# plug-ins: Motus
# Sequential goals: Joint State + two Plane goals wired to Plan.Goal (list) -> one chained trajectory. Click Plan, then drag Motus Scrub or Play.

ur10e = MotusUR10eRobotiq()
joints = MotusJointState(Joints=[0, -0.5, 1, -1, 0, 0])
joints_2 = MotusJointState(Joints=[1.2, -1, 1.2, -1.6, -1.5708, 0])
Z = UnitZ()
goalpt = ConstructPoint(X=0.45, Y=0.15, Z=0.45)
goalpt_2 = ConstructPoint(X=0.48, Y=0.18, Z=0.48)
goal = Plane(Origin=goalpt, Normal=Z)
goal_2 = Plane(Origin=goalpt_2, Normal=Z)
scrub = Slider(0, range=0..1)
quick = MotusPlan(
    Robot=ur10e,
    Goal=[joints_2, goal, goal_2],
    Start=joints,
    Step=0.005,
    ShowCollision=False,
    ShowGroup=False,
    ShowAttach=False,
    ShowRrtSettings=False)  # -> Trajectory, Status, Warnings
preview = MotusPreview(Trajectory=quick.Trajectory, ShowStart=False, Position=scrub)  # -> Meshes, Links, TCPPath, State, Time
export = MotusExport(Trajectory=quick.Trajectory, Retime=True, Validate=False)  # -> Json, Csv, Validation
